vi "In Compliance Query.gvi"   [LabVIEW NXG 5.0.0]
# Queries the instrument to determine if source is in current or voltage compliance.
inputs:
  "VISA resource name": "VISA Instr", required
    # A reference to the instrument in use.  The reference to the resource name is created in the Initialize VI.  Therefore, before calling this VI, you need to call the Initialize VI.  To run this VI interactively, select the previously initialized resource name from the pull-down menu.  To run this VI programmatically, wire the VISA resource name out terminal of the Initialize VI to subsequent VISA resource name input terminals.  You chain instrument driver VIs together by wiring the VISA resource name out terminal to subsequent VISA resource name input terminals.
  "error in (no error)": error
outputs:
  "VISA resource name out": "VISA Instr"  # A copy of the reference to the instrument in use. The reference to the resource name is created in the Initialize VI. Wire the VISA resource name out terminal of the Initialize VI to subsequent VISA resource name input terminals. You chain instrument driver VIs together by wiring the VISA resource name out terminal to subsequent VISA resource name input terminals.
  "Voltage Source": bool  # Indicates whether or not the source exceeded the current limits. True: In compliance. False: Not in compliance.
  "Current Source": bool  # Indicates whether or not the source has exceeded the voltage limits. True: In compliance. False: Not in compliance.
  "error out": error
uses:
  NI::VISA::Write (Instr, String).gvi
  NI::VISA::Read (Instr, String).gvi
  Labview_NXG_Keithley_SMU_2450_2460_2461::Utility::Error Query.gvi
diagram:
  call "Write (Instr, String).gvi"(session in=$"VISA resource name", error in=$"error in (no error)", write buffer=":SOUR:CURR:VLIM:TRIP?") -> (session out=w1, error out=w2)
  call "Read (Instr, String).gvi"(session in=w1, error in=w2, byte count=128) -> (session out=w3, error out=w4, read buffer=w5)
  call "Write (Instr, String).gvi"(session in=w3, error in=w4, write buffer=":SOUR:VOLT:ILIM:TRIP?") -> (session out=w6, error out=w7)
  call "Read (Instr, String).gvi"(session in=w6, error in=w7, byte count=128) -> (session out=w8, read buffer=w9)
  call "Error Query.gvi"(VISA resource name=w8) -> (VISA resource name out=w10, error out=w11)
  $"VISA resource name out" <- w10
  $"error out" <- w11
  Is Equal(x=w9, y="1\n") -> w12
  $"Current Source" <- w12
  Is Equal(x=w5, y="1\n") -> w13
  $"Voltage Source" <- w13
