vi "Get High Capacitance State.gvi"   [LabVIEW NXG 5.0.0]
# Gets state of High Capacitance mode on the instrument for both V and I.
inputs:
  "VISA resource name": "VISA Instr", required
    # A reference to the instrument in use.  The reference to the resource name is created in the Initialize VI.  Therefore, before calling this VI, you need to call the Initialize VI.  To run this VI interactively, select the previously initialized resource name from the pull-down menu.  To run this VI programmatically, wire the VISA resource name out terminal of the Initialize VI to subsequent VISA resource name input terminals.  You chain instrument driver VIs together by wiring the VISA resource name out terminal to subsequent VISA resource name input terminals.
  "error in (no error)": error
outputs:
  "VISA resource name out": "VISA Instr"  # A copy of the reference to the instrument in use. The reference to the resource name is created in the Initialize VI. Wire the VISA resource name out terminal of the Initialize VI to subsequent VISA resource name input terminals. You chain instrument driver VIs together by wiring the VISA resource name out terminal to subsequent VISA resource name input terminals.
  "Voltage High Capacitance Enabled?": bool  # The High Capacitance mode state for voltage source. True: Enabled. False: Disabled.
  "Current High Capacitance Enabled?": bool  # The High Capacitance mode state for current source. True: Enabled. False: Disabled.
  "error out": error
uses:
  NI::VISA::Write (Instr, String).gvi
  NI::VISA::Read (Instr, String).gvi
  Labview_NXG_Keithley_SMU_2450_2460_2461::Utility::Error Query.gvi
diagram:
  w1 = ":SOUR:VOLT:HIGH:CAP?"  # Voltage Auto Range
  call "Write (Instr, String).gvi"(session in=$"VISA resource name", error in=$"error in (no error)", write buffer=w1) -> (session out=w2, error out=w3)
  call "Read (Instr, String).gvi"(session in=w2, error in=w3, byte count=128) -> (session out=w4, error out=w5, read buffer=w6)
  Is Equal(x=w6, y="1\n") -> w7
  $"Voltage High Capacitance Enabled?" <- w7
  w8 = ":SOUR:CURR:HIGH:CAP?"  # Current Auto Range
  call "Write (Instr, String).gvi"(session in=w4, error in=w5, write buffer=w8) -> (session out=w9, error out=w10)
  call "Read (Instr, String).gvi"(session in=w9, error in=w10, byte count=128) -> (session out=w11, error out=w12, read buffer=w13)
  Is Equal(x=w13, y="1\n") -> w14
  $"Current High Capacitance Enabled?" <- w14
  call "Error Query.gvi"(VISA resource name=w11, error in (no error)=w12) -> (VISA resource name out=w15, error out=w16)
  $"VISA resource name out" <- w15
  $"error out" <- w16
