vi "Get Measurement Auto Range Lower Limit.gvi"   [LabVIEW NXG 5.0.0]
# Gets the measurement auto range lower limit for V, I and R on the instrument.
inputs:
  "VISA resource name": "VISA Instr"
    # A reference to the instrument in use.  The reference to the resource name is created in the Initialize VI.  Therefore, before calling this VI, you need to call the Initialize VI.  To run this VI interactively, select the previously initialized resource name from the pull-down menu.  To run this VI programmatically, wire the VISA resource name out terminal of the Initialize VI to subsequent VISA resource name input terminals.  You chain instrument driver VIs together by wiring the VISA resource name out terminal to subsequent VISA resource name input terminals.
  "error in (no error)": error
outputs:
  "VISA resource name out": "VISA Instr"  # A copy of the reference to the instrument in use. The reference to the resource name is created in the Initialize VI. Wire the VISA resource name out terminal of the Initialize VI to subsequent VISA resource name input terminals. You chain instrument driver VIs together by wiring the VISA resource name out terminal to subsequent VISA resource name input terminals.
  "Voltage AutoRange Lower Limit": f64  # The lowest range the voltage measure function will use when auto range is enabled.
  "Current AutoRange Lower Limit": f64  # The lowest range the current measure function will use when auto range is enabled.
  "Resistance AutoRange Lower Limit": f64  # The lowest range the resistance measure function will use when auto range is enabled.
  "error out": error
uses:
  NI::VISA::Write (Instr, String).gvi
  NI::VISA::Read (Instr, String).gvi
  Labview_NXG_Keithley_SMU_2450_2460_2461::Utility::Error Query.gvi
diagram:
  w1 = ":VOLT:RANG:AUTO:LLIMit?"  # Voltage Auto Range
  call "Write (Instr, String).gvi"(session in=$"VISA resource name", error in=$"error in (no error)", write buffer=w1) -> (session out=w2, error out=w3)
  call "Read (Instr, String).gvi"(session in=w2, error in=w3, byte count=128) -> (session out=w4, error out=w5, read buffer=w6)
  Floating Point String To Number(string=w6) -> (number=w7)
  $"Voltage AutoRange Lower Limit" <- w7
  w8 = ":CURR:RANG:AUTO:LLIMit?"  # Current Auto Range
  call "Write (Instr, String).gvi"(session in=w4, error in=w5, write buffer=w8) -> (session out=w9, error out=w10)
  call "Read (Instr, String).gvi"(session in=w9, error in=w10, byte count=128) -> (session out=w11, error out=w12, read buffer=w13)
  Floating Point String To Number(string=w13) -> (number=w14)
  $"Current AutoRange Lower Limit" <- w14
  w15 = ":RES:RANG:AUTO:LLIMit?"  # REsistance Auto Range
  call "Write (Instr, String).gvi"(session in=w11, error in=w12, write buffer=w15) -> (session out=w16, error out=w17)
  call "Read (Instr, String).gvi"(session in=w16, error in=w17, byte count=128) -> (session out=w18, error out=w19, read buffer=w20)
  Floating Point String To Number(string=w20) -> (number=w21)
  $"Resistance AutoRange Lower Limit" <- w21
  call "Error Query.gvi"(VISA resource name=w18, error in (no error)=w19) -> (VISA resource name out=w22, error out=w23)
  $"VISA resource name out" <- w22
  $"error out" <- w23
