vi "Get Measurement Auto Range.gvi"   [LabVIEW NXG 5.0.0]
# Gets whether the measurement auto range is enabled/disabled for V, I & R on the instrument.
inputs:
  "VISA resource name": "VISA Instr"
    # A reference to the instrument in use.  The reference to the resource name is created in the Initialize VI.  Therefore, before calling this VI, you need to call the Initialize VI.  To run this VI interactively, select the previously initialized resource name from the pull-down menu.  To run this VI programmatically, wire the VISA resource name out terminal of the Initialize VI to subsequent VISA resource name input terminals.  You chain instrument driver VIs together by wiring the VISA resource name out terminal to subsequent VISA resource name input terminals.
  "error in (no error)": error
outputs:
  "VISA resource name out": "VISA Instr"  # A copy of the reference to the instrument in use. The reference to the resource name is created in the Initialize VI. Wire the VISA resource name out terminal of the Initialize VI to subsequent VISA resource name input terminals. You chain instrument driver VIs together by wiring the VISA resource name out terminal to subsequent VISA resource name input terminals.
  "Voltage Auto Range Enabled?": bool  # Returns the voltage measure function autorange state. True: Autorange enabled. False: Autorange disabled.
  "Current Auto Range Enabled?": bool  # Returns the current measure function autorange state. True: Autorange enabled. False: Autorange disabled.
  "Resistance Auto Range Enabled?": bool  # Returns the resistance measure function autorange state. True: Autorange enabled. False: Autorange disabled.
  "error out": error
uses:
  NI::VISA::Write (Instr, String).gvi
  NI::VISA::Read (Instr, String).gvi
  Labview_NXG_Keithley_SMU_2450_2460_2461::Utility::Error Query.gvi
diagram:
  w1 = ":RES:RANG:AUTO?"  # REsistance Auto Range
  w2 = ":CURR:RANG:AUTO?"  # Current Auto Range
  w3 = ":VOLT:RANG:AUTO?"  # Voltage Auto Range
  call "Write (Instr, String).gvi"(session in=$"VISA resource name", error in=$"error in (no error)", write buffer=w3) -> (session out=w4, error out=w5)
  call "Read (Instr, String).gvi"(session in=w4, error in=w5, byte count=128) -> (session out=w6, error out=w7, read buffer=w8)
  call "Write (Instr, String).gvi"(session in=w6, error in=w7, write buffer=w2) -> (session out=w9, error out=w10)
  call "Read (Instr, String).gvi"(session in=w9, error in=w10, byte count=128) -> (session out=w11, error out=w12, read buffer=w13)
  call "Write (Instr, String).gvi"(session in=w11, error in=w12, write buffer=w1) -> (session out=w14, error out=w15)
  call "Read (Instr, String).gvi"(session in=w14, error in=w15, byte count=128) -> (session out=w16, error out=w17, read buffer=w18)
  call "Error Query.gvi"(VISA resource name=w16, error in (no error)=w17) -> (VISA resource name out=w19, error out=w20)
  $"VISA resource name out" <- w19
  $"error out" <- w20
  Is Equal(x=w18, y="1\n") -> w21
  $"Resistance Auto Range Enabled?" <- w21
  Is Equal(x=w13, y="1\n") -> w22
  $"Current Auto Range Enabled?" <- w22
  Is Equal(x=w8, y="1\n") -> w23
  $"Voltage Auto Range Enabled?" <- w23
