vi "VI Tree.gvi"   [LabVIEW NXG 5.0.0]
# This is the instrument driver for the Keithley 2400 Series SourceMeter. The VI Tree displays all the user-callable VIs of the instrument driver in an organized table.
uses:
  Labview_NXG_Keithley_SMU_2450_2460_2461::Action Status::Get Digital IO Pins Mode.gvi
  Labview_NXG_Keithley_SMU_2450_2460_2461::Action Status::Enable Remote Sensing.gvi
  Labview_NXG_Keithley_SMU_2450_2460_2461::Action Status::Get Digital IO Pins State.gvi
  Labview_NXG_Keithley_SMU_2450_2460_2461::Action Status::Enable Output.gvi
  Labview_NXG_Keithley_SMU_2450_2460_2461::Action Status::Set Digital IO Mode.gvi
  Labview_NXG_Keithley_SMU_2450_2460_2461::Action Status::Read all Digital IO Pins.gvi
  Labview_NXG_Keithley_SMU_2450_2460_2461::Action Status::In Compliance Query.gvi
  Labview_NXG_Keithley_SMU_2450_2460_2461::Miscelaneous::Initialize.gvi
  Labview_NXG_Keithley_SMU_2450_2460_2461::Miscelaneous::Close.gvi
  Labview_NXG_Keithley_SMU_2450_2460_2461::Action Status::Write to all Digital IO Pins.gvi
  Labview_NXG_Keithley_SMU_2450_2460_2461::Action Status::Set or Reset Digital IO Pins.gvi
  Labview_NXG_Keithley_SMU_2450_2460_2461::Configure::Create Configuration List.gvi
  Labview_NXG_Keithley_SMU_2450_2460_2461::Configure::Configure Brightness of Display.gvi
  Labview_NXG_Keithley_SMU_2450_2460_2461::Configure::Configure Reading Format of Display.gvi
  Labview_NXG_Keithley_SMU_2450_2460_2461::Configure::Get System Access Permission.gvi
  Labview_NXG_Keithley_SMU_2450_2460_2461::Configure::Configure Digits for Display.gvi
  Labview_NXG_Keithley_SMU_2450_2460_2461::Data::Fetch Read Buffer Statistics.gvi
  Labview_NXG_Keithley_SMU_2450_2460_2461::Data::Get Number of Readings in the Buffer.gvi
  Labview_NXG_Keithley_SMU_2450_2460_2461::Data::Make Reading and Store in Buffer.gvi
  Labview_NXG_Keithley_SMU_2450_2460_2461::Data::Query Limit Test Data.gvi
  Labview_NXG_Keithley_SMU_2450_2460_2461::Configure::Get Line Frequency.gvi
  Labview_NXG_Keithley_SMU_2450_2460_2461::Configure::Delete Configuration List.gvi
  Labview_NXG_Keithley_SMU_2450_2460_2461::Configure::Get Time.gvi
  Labview_NXG_Keithley_SMU_2450_2460_2461::Configure::Get GPIB Address.gvi
  Labview_NXG_Keithley_SMU_2450_2460_2461::Configure::Enable Logging.gvi
  Labview_NXG_Keithley_SMU_2450_2460_2461::Data::Read (Multiple Points).gvi
  Labview_NXG_Keithley_SMU_2450_2460_2461::Data::Read (Single Point).gvi
  Labview_NXG_Keithley_SMU_2450_2460_2461::Data::Read (Digitize).gvi
  Labview_NXG_Keithley_SMU_2450_2460_2461::Utility::Recall Configuration List.gvi
  Labview_NXG_Keithley_SMU_2450_2460_2461::Configure::Get Log State.gvi
  Labview_NXG_Keithley_SMU_2450_2460_2461::Configure::Get Version.gvi
  Labview_NXG_Keithley_SMU_2450_2460_2461::Configure::Getting Powered ON Setup.gvi
  Labview_NXG_Keithley_SMU_2450_2460_2461::Configure::Store Configuration List.gvi
  Labview_NXG_Keithley_SMU_2450_2460_2461::Configure::Save Message from Event Log.gvi
  Labview_NXG_Keithley_SMU_2450_2460_2461::Configure::Set GPIB Address.gvi
  Labview_NXG_Keithley_SMU_2450_2460_2461::Configure::Setting Powered ON Setup.gvi
  Labview_NXG_Keithley_SMU_2450_2460_2461::Configure::Set Absolute Time.gvi
  Labview_NXG_Keithley_SMU_2450_2460_2461::Data::Low Level::Fetch (Measurements).gvi
  Labview_NXG_Keithley_SMU_2450_2460_2461::Data::Low Level::Initiate.gvi
  Labview_NXG_Keithley_SMU_2450_2460_2461::Data::Low Level::Abort.gvi
  Labview_NXG_Keithley_SMU_2450_2460_2461::Data::Low Level::Send Software Trigger.gvi
  Labview_NXG_Keithley_SMU_2450_2460_2461::Data::Low Level::Wait for Operation Complete.gvi
  Labview_NXG_Keithley_SMU_2450_2460_2461::Data::Low Level::Measure Lowlevel.gvi
  Labview_NXG_Keithley_SMU_2450_2460_2461::Configure::Configure Linear Mode Sweep.gvi
  Labview_NXG_Keithley_SMU_2450_2460_2461::Configure::Configure Linear Step Mode Sweep.gvi
  Labview_NXG_Keithley_SMU_2450_2460_2461::Configure::Configure Log Mode Sweep.gvi
  Labview_NXG_Keithley_SMU_2450_2460_2461::Configure::Configure List Mode Sweep.gvi
  Labview_NXG_Keithley_SMU_2450_2460_2461::Configure::Configure Trigger Model Branch Counter Block.gvi
  Labview_NXG_Keithley_SMU_2450_2460_2461::Configure::Configure Trigger Model Always Block.gvi
  Labview_NXG_Keithley_SMU_2450_2460_2461::Configure::Clear Trigger timer.gvi
  Labview_NXG_Keithley_SMU_2450_2460_2461::Configure::Configure Trigger Model Blender Mode.gvi
  Labview_NXG_Keithley_SMU_2450_2460_2461::Configure::Configure Output List.gvi
  Labview_NXG_Keithley_SMU_2450_2460_2461::Configure::Configure Output Off Behavior.gvi
  Labview_NXG_Keithley_SMU_2450_2460_2461::Configure::Configure Output Sweep.gvi
  Labview_NXG_Keithley_SMU_2450_2460_2461::Configure::Configure Output.gvi
  Labview_NXG_Keithley_SMU_2450_2460_2461::Configure::Configure Filter.gvi
  Labview_NXG_Keithley_SMU_2450_2460_2461::Configure::Configure Trigger Model Clear Blender.gvi
  Labview_NXG_Keithley_SMU_2450_2460_2461::Configure::Configure Autozero Once.gvi
  Labview_NXG_Keithley_SMU_2450_2460_2461::Configure::Configure Autozero.gvi
  Labview_NXG_Keithley_SMU_2450_2460_2461::Configure::Configure Integration Filter.gvi
  Labview_NXG_Keithley_SMU_2450_2460_2461::Configure::Configure Trigger Model Clear LAN.gvi
  Labview_NXG_Keithley_SMU_2450_2460_2461::Configure::Configure Trigger Model Buffer Clear Block.gvi
  Labview_NXG_Keithley_SMU_2450_2460_2461::Configure::Configure Trigger Model Clear Digital Input Line.gvi
  Labview_NXG_Keithley_SMU_2450_2460_2461::Configure::Configure Over Voltage Protection.gvi
  Labview_NXG_Keithley_SMU_2450_2460_2461::Configure::Configure Source Function.gvi
  Labview_NXG_Keithley_SMU_2450_2460_2461::Configure::Configure Source Level.gvi
  Labview_NXG_Keithley_SMU_2450_2460_2461::Configure::Configure Source Limit Level.gvi
  Labview_NXG_Keithley_SMU_2450_2460_2461::Configure::Enable Limit Test.gvi
  Labview_NXG_Keithley_SMU_2450_2460_2461::Configure::Configure Limit Test Auto Clear.gvi
  Labview_NXG_Keithley_SMU_2450_2460_2461::Configure::Configure Limit Test Clear.gvi
  Labview_NXG_Keithley_SMU_2450_2460_2461::Configure::Configure Limit Test Lower Limit.gvi
  Labview_NXG_Keithley_SMU_2450_2460_2461::Configure::Configure Trigger Model Configuration List Previous index Block.gvi
  Labview_NXG_Keithley_SMU_2450_2460_2461::Configure::Configure Trigger Model Delta Block.gvi
  Labview_NXG_Keithley_SMU_2450_2460_2461::Configure::Configure Trigger Model Configuration List Next Index Block.gvi
  Labview_NXG_Keithley_SMU_2450_2460_2461::Configure::Configure Trigger Model Constant Delay Block.gvi
  Labview_NXG_Keithley_SMU_2450_2460_2461::Configure::Configure Source Range.gvi
  Labview_NXG_Keithley_SMU_2450_2460_2461::Configure::Enable High Capacitance.gvi
  Labview_NXG_Keithley_SMU_2450_2460_2461::Configure::Enable Source Auto Range.gvi
  Labview_NXG_Keithley_SMU_2450_2460_2461::Configure::Enable Source Read Back.gvi
  Labview_NXG_Keithley_SMU_2450_2460_2461::Configure::Configure Measurement Auto Range Upper Limit.gvi
  Labview_NXG_Keithley_SMU_2450_2460_2461::Configure::Configure Limit Test Upper Limit.gvi
  Labview_NXG_Keithley_SMU_2450_2460_2461::Configure::Configure Math.gvi
  Labview_NXG_Keithley_SMU_2450_2460_2461::Configure::Configure Measurement Auto Range Lower Limit.gvi
  Labview_NXG_Keithley_SMU_2450_2460_2461::Configure::Configure Trigger Model Digital Output Mode.gvi
  Labview_NXG_Keithley_SMU_2450_2460_2461::Configure::Configure Trigger Model LAN IP Address.gvi
  Labview_NXG_Keithley_SMU_2450_2460_2461::Configure::Configure Trigger Model Digital Input Mode.gvi
  Labview_NXG_Keithley_SMU_2450_2460_2461::Configure::Configure Trigger Model Digital Output Pulse Width.gvi
  Labview_NXG_Keithley_SMU_2450_2460_2461::Configure::Get High Capacitance State.gvi
  Labview_NXG_Keithley_SMU_2450_2460_2461::Configure::Get Interlock Status.gvi
  Labview_NXG_Keithley_SMU_2450_2460_2461::Configure::Get Source Auto Delay State.gvi
  Labview_NXG_Keithley_SMU_2450_2460_2461::Configure::Get Source Auto Range.gvi
  Labview_NXG_Keithley_SMU_2450_2460_2461::Configure::Configure Measurement Function.gvi
  Labview_NXG_Keithley_SMU_2450_2460_2461::Configure::Configure Measurement Manual Range.gvi
  Labview_NXG_Keithley_SMU_2450_2460_2461::Configure::Configure Measurement Range.gvi
  Labview_NXG_Keithley_SMU_2450_2460_2461::Configure::Configure Offset Compensation.gvi
  Labview_NXG_Keithley_SMU_2450_2460_2461::Configure::Configure Trigger Model LAN Output Protocol.gvi
  Labview_NXG_Keithley_SMU_2450_2460_2461::Configure::Configure Trigger Model Measure Block.gvi
  Labview_NXG_Keithley_SMU_2450_2460_2461::Configure::Configure Trigger Model LAN Output Logic Mode.gvi
  Labview_NXG_Keithley_SMU_2450_2460_2461::Configure::Configure Trigger Model LAN Trigger Mode.gvi
  Labview_NXG_Keithley_SMU_2450_2460_2461::Configure::Get Source Configuration List Catalog.gvi
  Labview_NXG_Keithley_SMU_2450_2460_2461::Configure::Get Source Configuration List Settings.gvi
  Labview_NXG_Keithley_SMU_2450_2460_2461::Configure::Get Source Configuration List Size.gvi
  Labview_NXG_Keithley_SMU_2450_2460_2461::Configure::Get Source Delay.gvi
  Labview_NXG_Keithley_SMU_2450_2460_2461::Configure::Configure Relative Offset.gvi
  Labview_NXG_Keithley_SMU_2450_2460_2461::Configure::Configure Settling Delay.gvi
  Labview_NXG_Keithley_SMU_2450_2460_2461::Configure::Configure Specific Limit Test.gvi
  Labview_NXG_Keithley_SMU_2450_2460_2461::Configure::Configure Unit of Current.gvi
  Labview_NXG_Keithley_SMU_2450_2460_2461::Configure::Configure Trigger Model Once Excluded Block.gvi
  Labview_NXG_Keithley_SMU_2450_2460_2461::Configure::Configure Trigger Model Source Output Block.gvi
  Labview_NXG_Keithley_SMU_2450_2460_2461::Configure::Configure Trigger Model Once Block.gvi
  Labview_NXG_Keithley_SMU_2450_2460_2461::Configure::Configure Trigger Model Recall Configuration List Block.gvi
  Labview_NXG_Keithley_SMU_2450_2460_2461::Configure::Get Source Function.gvi
  Labview_NXG_Keithley_SMU_2450_2460_2461::Configure::Get Source Level.gvi
  Labview_NXG_Keithley_SMU_2450_2460_2461::Configure::Get Source Limit.gvi
  Labview_NXG_Keithley_SMU_2450_2460_2461::Configure::Get Source List Points.gvi
  Labview_NXG_Keithley_SMU_2450_2460_2461::Configure::Configure Unit of Voltage.gvi
  Labview_NXG_Keithley_SMU_2450_2460_2461::Configure::Enable Math Operation.gvi
  Labview_NXG_Keithley_SMU_2450_2460_2461::Configure::Enable Measurement Auto Range.gvi
  Labview_NXG_Keithley_SMU_2450_2460_2461::Configure::Get Limit Test Enabled State.gvi
  Labview_NXG_Keithley_SMU_2450_2460_2461::Configure::Get Trigger Model Blender Mode.gvi
  Labview_NXG_Keithley_SMU_2450_2460_2461::Configure::Get Trigger Model Digital Input Mode.gvi
  Labview_NXG_Keithley_SMU_2450_2460_2461::Configure::Configure Trigger Model.gvi
  Labview_NXG_Keithley_SMU_2450_2460_2461::Configure::Get Trigger Model Blender Overrun Status.gvi
  Labview_NXG_Keithley_SMU_2450_2460_2461::Configure::Get Over Voltage Protection State.gvi
  Labview_NXG_Keithley_SMU_2450_2460_2461::Configure::Get Source Range.gvi
  Labview_NXG_Keithley_SMU_2450_2460_2461::Configure::Get Source User Delay.gvi
  Labview_NXG_Keithley_SMU_2450_2460_2461::Configure::Get Source Read Back State.gvi
  Labview_NXG_Keithley_SMU_2450_2460_2461::Configure::Get Limit Test Lower Limit.gvi
  Labview_NXG_Keithley_SMU_2450_2460_2461::Configure::Get Limit Test Upper Limit.gvi
  Labview_NXG_Keithley_SMU_2450_2460_2461::Configure::Get Measure Configuration List Catalog.gvi
  Labview_NXG_Keithley_SMU_2450_2460_2461::Configure::Get Measure Configuration List Settings.gvi
  Labview_NXG_Keithley_SMU_2450_2460_2461::Configure::Get Trigger Model Digital Output Pulse Width.gvi
  Labview_NXG_Keithley_SMU_2450_2460_2461::Configure::Get Trigger Model LAN Input Logic Mode.gvi
  Labview_NXG_Keithley_SMU_2450_2460_2461::Configure::Get Trigger Model Digital Output Mode.gvi
  Labview_NXG_Keithley_SMU_2450_2460_2461::Configure::Get Trigger Model Digital Overrun Status.gvi
  Labview_NXG_Keithley_SMU_2450_2460_2461::Configure::Get Measure Configuration List Size.gvi
  Labview_NXG_Keithley_SMU_2450_2460_2461::Configure::Get Measurement Auto Range Lower Limit.gvi
  Labview_NXG_Keithley_SMU_2450_2460_2461::Configure::Get Measurement Auto Range.gvi
  Labview_NXG_Keithley_SMU_2450_2460_2461::Configure::Get Measurement Count.gvi
  Labview_NXG_Keithley_SMU_2450_2460_2461::Configure::Get Trigger Model LAN Mode.gvi
  Labview_NXG_Keithley_SMU_2450_2460_2461::Configure::Get Trigger Model LAN Output Protocol.gvi
  Labview_NXG_Keithley_SMU_2450_2460_2461::Configure::Get Trigger Model LAN IP Address.gvi
  Labview_NXG_Keithley_SMU_2450_2460_2461::Configure::Get Trigger Model LAN Output Logic Mode.gvi
  Labview_NXG_Keithley_SMU_2450_2460_2461::Configure::Get Measurement Function.gvi
  Labview_NXG_Keithley_SMU_2450_2460_2461::Configure::Get Measurement Manual Range.gvi
  Labview_NXG_Keithley_SMU_2450_2460_2461::Configure::Get Measure User Delay.gvi
  Labview_NXG_Keithley_SMU_2450_2460_2461::Configure::Set Measurement Count.gvi
  Labview_NXG_Keithley_SMU_2450_2460_2461::Configure::Get Trigger Model State.gvi
  Labview_NXG_Keithley_SMU_2450_2460_2461::Configure::Get Trigger Timer Delay.gvi
  Labview_NXG_Keithley_SMU_2450_2460_2461::Configure::Configure Contact Check.gvi
  Labview_NXG_Keithley_SMU_2450_2460_2461::Configure::Get Conact Check State.gvi
  Labview_NXG_Keithley_SMU_2450_2460_2461::Configure::Configure Pulse Limit.gvi
  Labview_NXG_Keithley_SMU_2450_2460_2461::Configure::Set Pulse Amplitude.gvi
  Labview_NXG_Keithley_SMU_2450_2460_2461::Configure::Get Trigger Model LAN Overrun Status.gvi
  Labview_NXG_Keithley_SMU_2450_2460_2461::Configure::Get Trigger Timer Count.gvi
  Labview_NXG_Keithley_SMU_2450_2460_2461::Configure::Get Trigger Timer State.gvi
  Labview_NXG_Keithley_SMU_2450_2460_2461::Configure::Configure Pulse Train.gvi
  Labview_NXG_Keithley_SMU_2450_2460_2461::Configure::Configure Pulse Sweep.gvi
  Labview_NXG_Keithley_SMU_2450_2460_2461::Configure::Configure Pulse List Sweep.gvi
  Labview_NXG_Keithley_SMU_2450_2460_2461::Configure::Set Trigger Timer Delay.gvi
  Labview_NXG_Keithley_SMU_2450_2460_2461::Configure::Get Trigger Timer Overrun Status.gvi
  Labview_NXG_Keithley_SMU_2450_2460_2461::Configure::Set Trigger Timer Count.gvi
  Labview_NXG_Keithley_SMU_2450_2460_2461::Configure::Enable LAN Connect State.gvi
  Labview_NXG_Keithley_SMU_2450_2460_2461::Configure::Digitizer Aperture.gvi
  Labview_NXG_Keithley_SMU_2450_2460_2461::Configure::Digitizer Voltage Units.gvi
  Labview_NXG_Keithley_SMU_2450_2460_2461::Configure::Digitizer Sample Rate.gvi
  Labview_NXG_Keithley_SMU_2450_2460_2461::Configure::Digitizer Current Units.gvi
  Labview_NXG_Keithley_SMU_2450_2460_2461::Configure::Set Trigger Timer State.gvi
  Labview_NXG_Keithley_SMU_2450_2460_2461::Configure::Get LAN Connect State.gvi
  Labview_NXG_Keithley_SMU_2450_2460_2461::Utility::Calibrate Adjust Sense Data Query.gvi
  Labview_NXG_Keithley_SMU_2450_2460_2461::Utility::Calibrate Adjust Sense.gvi
  Labview_NXG_Keithley_SMU_2450_2460_2461::Utility::Calibrate Adjust Source Data Query.gvi
  Labview_NXG_Keithley_SMU_2450_2460_2461::Utility::Calibrate Adjust Source.gvi
  Labview_NXG_Keithley_SMU_2450_2460_2461::Utility::Calibration Adjust Count Query.gvi
  Labview_NXG_Keithley_SMU_2450_2460_2461::Utility::Calibration Adjust Date Query.gvi
  Labview_NXG_Keithley_SMU_2450_2460_2461::Utility::Calibration Adjust Date.gvi
  Labview_NXG_Keithley_SMU_2450_2460_2461::Utility::Calibration Lock.gvi
  Labview_NXG_Keithley_SMU_2450_2460_2461::Utility::Create Math Operation.gvi
  Labview_NXG_Keithley_SMU_2450_2460_2461::Utility::Clear Display.gvi
  Labview_NXG_Keithley_SMU_2450_2460_2461::Utility::Set Display Screen.gvi
  Labview_NXG_Keithley_SMU_2450_2460_2461::Utility::Clear System Event Log.gvi
  Labview_NXG_Keithley_SMU_2450_2460_2461::Utility::Calibration Unlock.gvi
  Labview_NXG_Keithley_SMU_2450_2460_2461::Utility::Calibration Password.gvi
  Labview_NXG_Keithley_SMU_2450_2460_2461::Utility::Calibration Save.gvi
  Labview_NXG_Keithley_SMU_2450_2460_2461::Utility::Calibration Verify Date.gvi
  Labview_NXG_Keithley_SMU_2450_2460_2461::Utility::Display Message.gvi
  Labview_NXG_Keithley_SMU_2450_2460_2461::Utility::Enable Questionable Event Register.gvi
  Labview_NXG_Keithley_SMU_2450_2460_2461::Utility::Emit Beep.gvi
  Labview_NXG_Keithley_SMU_2450_2460_2461::Utility::Enable Operation Event Register.gvi
  Labview_NXG_Keithley_SMU_2450_2460_2461::Configure::Clear Buffer.gvi
  Labview_NXG_Keithley_SMU_2450_2460_2461::Configure::Clear Buffer Statistics.gvi
  Labview_NXG_Keithley_SMU_2450_2460_2461::Configure::Delete User Buffer.gvi
  Labview_NXG_Keithley_SMU_2450_2460_2461::Configure::Append Buffer to File in the USB.gvi
  Labview_NXG_Keithley_SMU_2450_2460_2461::Utility::Calibration Verify Date Query.gvi
  Labview_NXG_Keithley_SMU_2450_2460_2461::Utility::Error Query.gvi
  Labview_NXG_Keithley_SMU_2450_2460_2461::Utility::Get Event Id Mapped to Bit Number in Operation Event Register.gvi
  Labview_NXG_Keithley_SMU_2450_2460_2461::Utility::Get Active Terminals.gvi
  Labview_NXG_Keithley_SMU_2450_2460_2461::Utility::Self-Test.gvi
  Labview_NXG_Keithley_SMU_2450_2460_2461::Configure::Get Buffer Size.gvi
  Labview_NXG_Keithley_SMU_2450_2460_2461::Configure::Get Buffer Filling Mode.gvi
  Labview_NXG_Keithley_SMU_2450_2460_2461::Configure::Get Byte Order.gvi
  Labview_NXG_Keithley_SMU_2450_2460_2461::Configure::Create User Buffer.gvi
  Labview_NXG_Keithley_SMU_2450_2460_2461::Utility::Get Event Id Mapped to Bit Number in Questionable Event Register.gvi
  Labview_NXG_Keithley_SMU_2450_2460_2461::Utility::Map Event Id to Bit number in Operation Event Register.gvi
  Labview_NXG_Keithley_SMU_2450_2460_2461::Utility::Get Min-Max Ranges.gvi
  Labview_NXG_Keithley_SMU_2450_2460_2461::Utility::Get Trigger Block List.gvi
  Labview_NXG_Keithley_SMU_2450_2460_2461::Configure::Set Buffer Filling Mode.gvi
  Labview_NXG_Keithley_SMU_2450_2460_2461::Configure::Save Buffer to File in the USB.gvi
  Labview_NXG_Keithley_SMU_2450_2460_2461::Configure::Set Buffer Size.gvi
  Labview_NXG_Keithley_SMU_2450_2460_2461::Configure::Get Data Format.gvi
  Labview_NXG_Keithley_SMU_2450_2460_2461::Utility::Map Event Id to Bit number in Questionable Event Register.gvi
  Labview_NXG_Keithley_SMU_2450_2460_2461::Utility::Read Operation Event Register Status.gvi
  Labview_NXG_Keithley_SMU_2450_2460_2461::Utility::Preset Status.gvi
  Labview_NXG_Keithley_SMU_2450_2460_2461::Utility::Read Operation Condition Register.gvi
  Labview_NXG_Keithley_SMU_2450_2460_2461::Configure::Configure Byte Order.gvi
  Labview_NXG_Keithley_SMU_2450_2460_2461::Utility::Read Operation Event Register.gvi
  Labview_NXG_Keithley_SMU_2450_2460_2461::Utility::Read Questionable Event Register.gvi
  Labview_NXG_Keithley_SMU_2450_2460_2461::Utility::Read Questionable Condition Register.gvi
  Labview_NXG_Keithley_SMU_2450_2460_2461::Utility::Read Questionable Event Register Status.gvi
  Labview_NXG_Keithley_SMU_2450_2460_2461::Utility::Reset.gvi
  Labview_NXG_Keithley_SMU_2450_2460_2461::Utility::Selected Range Query.gvi
  Labview_NXG_Keithley_SMU_2450_2460_2461::Utility::Revision Query.gvi
  Labview_NXG_Keithley_SMU_2450_2460_2461::Utility::Select Active Terminals.gvi
diagram:
  call "Get Digital IO Pins Mode.gvi"()
  call "Enable Remote Sensing.gvi"()
  call "Get Digital IO Pins State.gvi"()
  # Action-Status
  call "Enable Output.gvi"()
  call "Set Digital IO Mode.gvi"()
  call "Read all Digital IO Pins.gvi"()
  call "In Compliance Query.gvi"()
  # Initialize
  call "Initialize.gvi"()
  # Close
  call "Close.gvi"()
  call "Write to all Digital IO Pins.gvi"()
  call "Set or Reset Digital IO Pins.gvi"()
  call "Create Configuration List.gvi"()
  # Configure
  call "Configure Brightness of Display.gvi"()
  call "Configure Reading Format of Display.gvi"()
  call "Get System Access Permission.gvi"()
  call "Configure Digits for Display.gvi"()
  # Data
  call "Fetch Read Buffer Statistics.gvi"()
  call "Get Number of Readings in the Buffer.gvi"()
  call "Make Reading and Store in Buffer.gvi"()
  call "Query Limit Test Data.gvi"()
  call "Get Line Frequency.gvi"()
  call "Delete Configuration List.gvi"()
  call "Get Time.gvi"()
  call "Get GPIB Address.gvi"()
  call "Enable Logging.gvi"()
  call "Read (Multiple Points).gvi"()
  call "Read (Single Point).gvi"()
  call "Read (Digitize).gvi"()
  call "Recall Configuration List.gvi"()
  call "Get Log State.gvi"()
  call "Get Version.gvi"()
  call "Getting Powered ON Setup.gvi"()
  call "Get System Access Permission.gvi"()
  call "Store Configuration List.gvi"()
  call "Save Message from Event Log.gvi"()
  call "Set GPIB Address.gvi"()
  call "Setting Powered ON Setup.gvi"()
  call "Set Absolute Time.gvi"()
  call "Fetch (Measurements).gvi"()
  call "Initiate.gvi"()
  # Data, Low Level
  call "Abort.gvi"()
  call "Send Software Trigger.gvi"()
  call "Wait for Operation Complete.gvi"()
  call "Measure Lowlevel.gvi"()
  # Configure, Source
  call "Configure Linear Mode Sweep.gvi"()
  call "Configure Linear Step Mode Sweep.gvi"()
  call "Configure Log Mode Sweep.gvi"()
  call "Configure List Mode Sweep.gvi"()
  call "Configure Trigger Model Branch Counter Block.gvi"()
  call "Configure Trigger Model Always Block.gvi"()
  # Configure, Trigger
  call "Clear Trigger timer.gvi"()
  call "Configure Trigger Model Blender Mode.gvi"()
  call "Configure Output List.gvi"()
  call "Configure Output Off Behavior.gvi"()
  call "Configure Output Sweep.gvi"()
  call "Configure Output.gvi"()
  call "Configure Filter.gvi"()
  call "Configure Trigger Model Clear Blender.gvi"()
  # Configure, Measure
  call "Configure Autozero Once.gvi"()
  call "Configure Autozero.gvi"()
  call "Configure Integration Filter.gvi"()
  call "Configure Trigger Model Clear LAN.gvi"()
  call "Configure Trigger Model Buffer Clear Block.gvi"()
  call "Configure Trigger Model Clear Digital Input Line.gvi"()
  call "Configure Over Voltage Protection.gvi"()
  call "Configure Source Function.gvi"()
  call "Configure Source Level.gvi"()
  call "Configure Source Limit Level.gvi"()
  call "Enable Limit Test.gvi"()
  call "Configure Limit Test Auto Clear.gvi"()
  call "Configure Limit Test Clear.gvi"()
  call "Configure Limit Test Lower Limit.gvi"()
  call "Configure Trigger Model Configuration List Previous index Block.gvi"()
  call "Configure Trigger Model Delta Block.gvi"()
  call "Configure Trigger Model Configuration List Next Index Block.gvi"()
  call "Configure Trigger Model Constant Delay Block.gvi"()
  call "Configure Source Range.gvi"()
  call "Enable High Capacitance.gvi"()
  call "Enable Source Auto Range.gvi"()
  call "Enable Source Read Back.gvi"()
  call "Configure Measurement Auto Range Upper Limit.gvi"()
  call "Configure Limit Test Upper Limit.gvi"()
  call "Configure Math.gvi"()
  call "Configure Measurement Auto Range Lower Limit.gvi"()
  call "Configure Trigger Model Digital Output Mode.gvi"()
  call "Configure Trigger Model LAN IP Address.gvi"()
  call "Configure Trigger Model Digital Input Mode.gvi"()
  call "Configure Trigger Model Digital Output Pulse Width.gvi"()
  call "Get High Capacitance State.gvi"()
  call "Get Interlock Status.gvi"()
  call "Get Source Auto Delay State.gvi"()
  call "Get Source Auto Range.gvi"()
  call "Configure Measurement Function.gvi"()
  call "Configure Measurement Manual Range.gvi"()
  call "Configure Measurement Range.gvi"()
  call "Configure Offset Compensation.gvi"()
  call "Configure Trigger Model LAN Output Protocol.gvi"()
  call "Configure Trigger Model Measure Block.gvi"()
  call "Configure Trigger Model LAN Output Logic Mode.gvi"()
  call "Configure Trigger Model LAN Trigger Mode.gvi"()
  call "Get Source Configuration List Catalog.gvi"()
  call "Get Source Configuration List Settings.gvi"()
  call "Get Source Configuration List Size.gvi"()
  call "Get Source Delay.gvi"()
  call "Configure Relative Offset.gvi"()
  call "Configure Settling Delay.gvi"()
  call "Configure Specific Limit Test.gvi"()
  call "Configure Unit of Current.gvi"()
  call "Configure Trigger Model Once Excluded Block.gvi"()
  call "Configure Trigger Model Source Output Block.gvi"()
  call "Configure Trigger Model Once Block.gvi"()
  call "Configure Trigger Model Recall Configuration List Block.gvi"()
  call "Get Source Function.gvi"()
  call "Get Source Level.gvi"()
  call "Get Source Limit.gvi"()
  call "Get Source List Points.gvi"()
  call "Configure Unit of Voltage.gvi"()
  call "Enable Math Operation.gvi"()
  call "Enable Measurement Auto Range.gvi"()
  call "Get Limit Test Enabled State.gvi"()
  call "Get Trigger Model Blender Mode.gvi"()
  call "Get Trigger Model Digital Input Mode.gvi"()
  call "Configure Trigger Model.gvi"()
  call "Get Trigger Model Blender Overrun Status.gvi"()
  call "Get Over Voltage Protection State.gvi"()
  call "Get Source Range.gvi"()
  call "Get Source User Delay.gvi"()
  call "Get Source Read Back State.gvi"()
  call "Get Limit Test Lower Limit.gvi"()
  call "Get Limit Test Upper Limit.gvi"()
  call "Get Measure Configuration List Catalog.gvi"()
  call "Get Measure Configuration List Settings.gvi"()
  call "Get Trigger Model Digital Output Pulse Width.gvi"()
  call "Get Trigger Model LAN Input Logic Mode.gvi"()
  call "Get Trigger Model Digital Output Mode.gvi"()
  call "Get Trigger Model Digital Overrun Status.gvi"()
  call "Get Measure Configuration List Size.gvi"()
  call "Get Measurement Auto Range Lower Limit.gvi"()
  call "Get Measurement Auto Range.gvi"()
  call "Get Measurement Count.gvi"()
  call "Get Trigger Model LAN Mode.gvi"()
  call "Get Trigger Model LAN Output Protocol.gvi"()
  call "Get Trigger Model LAN IP Address.gvi"()
  call "Get Trigger Model LAN Output Logic Mode.gvi"()
  call "Get Measurement Function.gvi"()
  call "Get Measurement Manual Range.gvi"()
  call "Get Measure User Delay.gvi"()
  call "Set Measurement Count.gvi"()
  call "Get Trigger Model State.gvi"()
  call "Get Trigger Timer Delay.gvi"()
  # 2461 Specific VIs
  call "Configure Contact Check.gvi"()
  call "Get Conact Check State.gvi"()
  call "Configure Pulse Limit.gvi"()
  call "Set Pulse Amplitude.gvi"()
  call "Get Trigger Model LAN Overrun Status.gvi"()
  call "Get Trigger Timer Count.gvi"()
  call "Get Trigger Timer State.gvi"()
  call "Configure Pulse Train.gvi"()
  call "Configure Pulse Sweep.gvi"()
  call "Configure Pulse List Sweep.gvi"()
  call "Set Trigger Timer Delay.gvi"()
  call "Get Trigger Timer Overrun Status.gvi"()
  call "Set Trigger Timer Count.gvi"()
  call "Enable LAN Connect State.gvi"()
  call "Digitizer Aperture.gvi"()
  call "Digitizer Voltage Units.gvi"()
  # 2461 Specific VIs
  call "Digitizer Sample Rate.gvi"()
  call "Digitizer Current Units.gvi"()
  call "Set Trigger Timer State.gvi"()
  call "Get LAN Connect State.gvi"()
  # Calibration
  call "Calibrate Adjust Sense Data Query.gvi"()
  call "Calibrate Adjust Sense.gvi"()
  call "Calibrate Adjust Source Data Query.gvi"()
  call "Calibrate Adjust Source.gvi"()
  call "Calibration Adjust Count Query.gvi"()
  call "Calibration Adjust Date Query.gvi"()
  call "Calibration Adjust Date.gvi"()
  call "Calibration Lock.gvi"()
  call "Create Math Operation.gvi"()
  # Utility
  call "Clear Display.gvi"()
  call "Set Display Screen.gvi"()
  call "Clear System Event Log.gvi"()
  call "Calibration Unlock.gvi"()
  call "Calibration Password.gvi"()
  call "Calibration Save.gvi"()
  call "Calibration Verify Date.gvi"()
  call "Display Message.gvi"()
  call "Enable Questionable Event Register.gvi"()
  call "Emit Beep.gvi"()
  call "Enable Operation Event Register.gvi"()
  call "Clear Buffer.gvi"()
  call "Clear Buffer Statistics.gvi"()
  call "Delete User Buffer.gvi"()
  # Configure, Buffer
  call "Append Buffer to File in the USB.gvi"()
  call "Calibration Verify Date Query.gvi"()
  call "Error Query.gvi"()
  call "Get Event Id Mapped to Bit Number in Operation Event Register.gvi"()
  call "Get Active Terminals.gvi"()
  call "Self-Test.gvi"()
  call "Get Buffer Size.gvi"()
  call "Get Buffer Filling Mode.gvi"()
  call "Get Byte Order.gvi"()
  call "Create User Buffer.gvi"()
  call "Get Event Id Mapped to Bit Number in Questionable Event Register.gvi"()
  call "Map Event Id to Bit number in Operation Event Register.gvi"()
  call "Get Min-Max Ranges.gvi"()
  call "Get Trigger Block List.gvi"()
  call "Set Buffer Filling Mode.gvi"()
  call "Save Buffer to File in the USB.gvi"()
  call "Set Buffer Size.gvi"()
  call "Get Data Format.gvi"()
  call "Map Event Id to Bit number in Questionable Event Register.gvi"()
  call "Read Operation Event Register Status.gvi"()
  call "Preset Status.gvi"()
  call "Read Operation Condition Register.gvi"()
  call "Configure Byte Order.gvi"()
  call "Read Operation Event Register.gvi"()
  call "Read Questionable Event Register.gvi"()
  call "Read Questionable Condition Register.gvi"()
  call "Read Questionable Event Register Status.gvi"()
  call "Reset.gvi"()
  call "Selected Range Query.gvi"()
  call "Revision Query.gvi"()
  call "Select Active Terminals.gvi"()
